# Grasshopper definition 5_DF_Collaboration_Final.gh (Grasshopper 1.0.7)
# plug-ins: ABxM.Grasshopper, Human

# © 2023 by ICD University of Stuttgart
crv = Curve(<curve referenced from the Rhino model>)

material_count = Panel("1")
material_radius = Slider(42, range=0..100)

body_name = Data()
data = Data()

number_slider = Slider(64, range=0..200)
swatch = ColourSwatch(SwatchColor=RGB(75, 112, 214))
D = Slider(0.329, range=0..10)
number_slider_2 = Slider(5, range=0..5)
# CONTROL
agent_count = Panel("3")
cohere_meters = Slider(0.13, range=0..10)
number_slider_3 = Slider(1, range=0..1)
sight = Slider(500, range=0..1000)
pickupdistance = Slider(186, range=0..1000)
sightrotationdegrees = Slider(40, range=0..100)
robot_radius = Slider(80, range=0..100)

robots_in_use = Panel("""1
3
4
5
6
7
8
10""")
tree_branch = TreeBranch(Tree=data, Path=Slider(0, range=0..1), MaintainPaths=True)
list_item = ListItem(List=data, Index=0, Wrap=True)  # -> Item, Item1, Item2, Item3
# OPTRITRACK
list_item_2 = ListItem(List=body_name, Index=0, Wrap=True)  # -> Item, Item1
material_in_use = Panel("""1
2
3
4
5
6
7
8""")
number_slider_4 = Slider(100, range=0..100)
plane_3pt = Plane3Pt(PointA=list_item.Item, PointB=list_item.Item1, PointC=list_item.Item2)
name = Data(body_name)
flip_plane = FlipPlane(Plane=plane_3pt, ReverseX=False, ReverseY=True, SwapAxes=True)  # -> flatten(Plane)
plane = Plane(flip_plane)

number_slider_5 = Slider(1000, range=0..1000)
number_slider_6 = Slider(350, range=0..1000)
c_script = CSharpScript(
    D=number_slider_5,
    sD=number_slider_6,
    Reference="\\MAC\HOME\DESKTOP\2023DF\AHIMOV\SOFTWARE\DATAVERSE_FILES\ABXM.CORE-1.4.0\ABMFRAMEWORK.CORE\ABxM.Core.dll")  # -> oBehavior, A; inputs D: Double, sD: Double
# ---------- c_script: C# usings ----------
using ABxM.Core.Agent;
using ABxM.Core.AgentSystem;
using ABxM.Core.Behavior;
using ABxM.Core.Environments;
using ABxM.Core.Utilities;
using Grasshopper.GUI;
# ---------- c_script: C# ----------
    //

    behavior.distence = D;
    behavior.stopdistence = sD;
    oBehavior = behavior;
# ---------- c_script: C# additional code ----------
  public FindNeighborBehavior behavior = new FindNeighborBehavior();

  public class FindNeighborBehavior : BehaviorBase
  {

    public double distence = 10;
    public double stopdistence = 10;
    public double len = 0;

    public override void Execute(AgentBase agent)
    {
      Boid boid = agent as Boid;
      BoidSystem sys = (BoidSystem) boid.AgentSystem;

      Vector3d r = new Vector3d(0, 0, 0);

      List<Boid> neighbors = sys.FindNeighbors(boid, distence);

      if (neighbors.Count > 0 && (bool) boid.CustomData["Wait"] == false && (bool) boid.CustomData["beConnected"] == false)
      {
        for (int i = 0; i < neighbors.Count; i++)
        {
          Vector3d newderection = (neighbors[i] as Boid).Position - boid.Position;
          Vector3d tarderection = newderection - boid.Velocity;
          double len = newderection.Length;

          if (len > stopdistence && (bool) neighbors[i].CustomData["beConnected"] == false && (bool) boid.CustomData["Connect"] == false
            && (bool) neighbors[i].CustomData["Wait"] == true)
          {
            boid.CustomData["StopFinding"] = true;
            //hadOne = true;
            boid.Velocity = tarderection;
          }


          if (len <= stopdistence && (bool) neighbors[i].CustomData["beConnected"] == false && (bool) boid.CustomData["StopFinding"] == true
            && (bool) neighbors[i].CustomData["Wait"] == true)
          {
            boid.Velocity = new Vector3d(0, 0, 0);
            boid.CustomData["Connect"] = true;
            Vector3d up = new Point3d(neighbors[i].Position.X, neighbors[i].Position.Y, neighbors[i].Position.Z + 5) - neighbors[i].Position;
            r = boid.Position - neighbors[i].Position;
            r.Rotate(0.5 * Math.PI, up);
            r.Unitize();
            boid.Velocity = 300 * r;
          }

          if ((bool) boid.CustomData["Connect"] == true && (bool) neighbors[i].CustomData["beConnected"] == true)
          {
            tarderection.Unitize();
            boid.Velocity = tarderection * 18;

          }
          return;
        }

      }

      List<Boid> neighbors2 = sys.FindNeighbors(boid, 400);
      if(neighbors2.Count > 0 && (bool) boid.CustomData["Wait"] == false && (bool) boid.CustomData["beConnected"] == false)
      {}
      else
      {
        boid.CustomData["beConnected"] = false;
        boid.CustomData["Connect"] = false;
        boid.CustomData["StopFinding"] = false;
      }

    }
  }
# ---------- end c_script ----------

# ----
# AGENT SYSTEM
boundary = Curve(crv)

# ----
# MOBILE ROBOT
# ADV. BEHAVIORS
rad = Radians(Degrees=sightrotationdegrees)
robotpickup = Number(pickupdistance)
material_radius_2 = Number(material_radius)
robotsightrotation = Number(rad)
robot_radius_2 = Number(robot_radius)
pickpush = CSharpScript(
    iRobotPickRotation=robotsightrotation,
    iRobotPickLength=robotpickup,
    iRobotRadius=robot_radius_2,
    iMaterialRadius=material_radius_2,
    Reference="\\MAC\HOME\DESKTOP\2023DF\AHIMOV\SOFTWARE\DATAVERSE_FILES\ABXM.CORE-1.4.0\ABMFRAMEWORK.CORE\ABxM.Core.dll")  # -> out, oBehavior; inputs iRobotPickRotation: Double, iRobotPickLength: Double, iRobotRadius: Double, iMaterialRadius: Double
# ---------- pickpush: C# usings ----------
using ABxM.Core;
using ABxM.Core.Agent;
using ABxM.Core.AgentSystem;
using ABxM.Core.Behavior;
using ABxM.Core.Environments;
# ---------- pickpush: C# ----------
    behavior.pickRadius = iRobotPickLength;
    behavior.pushRadius = iRobotRadius + iMaterialRadius;
    behavior.pickRotation = iRobotPickRotation;
    oBehavior = behavior;
# ---------- pickpush: C# additional code ----------
  PickPushBehavior behavior = new PickPushBehavior();

  public class PickPushBehavior : BehaviorBase
  {
    public double pickRadius = 100;
    public double pickRotation = 45;
    public double pushRadius = 100;

    public override void Execute(AgentBase agent)
    {
      Boid boid = agent as Boid;
      BoidSystem sys = (BoidSystem) boid.AgentSystem;

      if ( (bool) boid.CustomData["Gripping"] == false && (bool) boid.CustomData["Connect"] == false)
      {
        Vector3d vel = boid.Velocity;
        Vector3d v = (Vector3d) boid.CustomData["Direction"];
        double angle = Vector3d.VectorAngle(vel, v);

        if (angle < Math.PI / 2)
        {

          // Create Sight of Robot
          List<Point3d> ptsSightTriangle = new List<Point3d>();
          v.Unitize();
          v = v * pickRadius;

          //Add
          ptsSightTriangle.Add(new Point3d(boid.Position.X, boid.Position.Y, boid.Position.Z));
          Vector3d z = new Point3d(boid.Position.X, boid.Position.Y, boid.Position.Z + 10) - boid.Position;
          v.Rotate(pickRotation, z);
          ptsSightTriangle.Add(new Point3d(boid.Position.X, boid.Position.Y, boid.Position.Z) + v);
          v.Rotate(-2 * pickRotation, z);
          ptsSightTriangle.Add(new Point3d(boid.Position.X, boid.Position.Y, boid.Position.Z) + v);
          v.Rotate(pickRotation, z);
          ptsSightTriangle.Add(new Point3d(boid.Position.X, boid.Position.Y, boid.Position.Z));

          PolylineCurve sight = new PolylineCurve(ptsSightTriangle);



          CartesianAgentSystem materialSystem = this.Solver.AgentSystems[0] as CartesianAgentSystem;

          for (int i = 0; i < materialSystem.Agents.Count; i++)
          {
            CartesianAgent material = materialSystem.Agents[i] as CartesianAgent;


            if (sight.Contains(material.Position) == PointContainment.Inside && (bool) material.CustomData["Collected"] == false)
            {
              boid.CustomData["Gripping"] = true;
              boid.CustomData["MaterialAgent"] = material;
              boid.CustomData["GripCount"] = 1;
              /*if ((bool) boid.CustomData["Wait"] == true)
              {
                boid.Velocity = new Vector3d (0, 0, 0);
              }*/

              material.CustomData["Collected"] = true;

              //boid.Velocity = new Vector3d (0, 0, 0);
              //material.CustomData["Moving"] = true;
              //Vector3d pushVect = boid.Velocity;
              //pushVect.Unitize();
              //material.Position = boid.Position + pushVect * pushRadius;


              //
              //
              //BoidSystem system = (BoidSystem) boid.AgentSystem;
              //MeshEnvironment env = (MeshEnvironment) system.SurfEnvironment;
              //Mesh mesh = env.Mesh;




              return;
            }
          }
        }
      }

      if ( (bool) boid.CustomData["Gripping"] == true )
      {
        CartesianAgent material = (CartesianAgent) boid.CustomData["MaterialAgent"];
        Vector3d pushVect = boid.Velocity;
        //pushVect.Unitize();
        //material.Position = boid.Position + pushVect * pushRadius;
        material.Position = boid.Position + (Vector3d) boid.CustomData["Direction"];
        if ((int) boid.CustomData["GripCount"] < 10)
        {
          boid.AddForce(pushVect);
        }
        else
        {
          if ( (bool) boid.CustomData["beConnected"] == false)
          {

            boid.Velocity = new Vector3d (0, 0, 0);
            boid.CustomData["Wait"] = true;
          }


        }
        boid.CustomData["GripCount"] = (int) boid.CustomData["GripCount"] + 1;
      }
    }

  }


  /// <summary>
  /// This method will be called once every solution, before any calls to RunScript.
  /// </summary>
  public override void BeforeRunScript()
  { }
  /// <summary>
  /// This method will be called once every solution, after any calls to RunScript.
  /// </summary>
  public override void AfterRunScript()
  { }
# ---------- end pickpush ----------

# ----
# Slow down on
# material approach
# Pick up / Push material
# FindNeighbors
# GoBackHome
# Drops Block when Home
rad_2 = Radians(Degrees=sightrotationdegrees)
pt = Point(Point(-1486.172936, -1608.943782, 0))
robotsight = Number(sight)
material_radius_3 = Number(material_radius)
robotsightrotation_2 = Number(rad_2)
material_radius_4 = Number(material_radius)
robot_radius_3 = Number(robot_radius)
robot_radius_4 = Number(robot_radius)
slowdown = CSharpScript(
    iRobotSightRotation=robotsightrotation_2,
    iRobotSightLength=robotsight,
    iRobotRadius=robot_radius_3,
    iMaterialRadius=material_radius_3,
    Reference="\\MAC\HOME\DESKTOP\2023DF\AHIMOV\SOFTWARE\DATAVERSE_FILES\ABXM.CORE-1.4.0\ABMFRAMEWORK.CORE\ABxM.Core.dll")  # -> out, oBehavior; inputs iRobotSightRotation: Double, iRobotSightLength: Double, iRobotRadius: Double, iMaterialRadius: Double
# ---------- slowdown: C# ----------
    behavior.sightRadius = iRobotSightLength;
    behavior.pushRadius = iRobotRadius + iMaterialRadius;
    behavior.sightRotation = iRobotSightRotation;

    oBehavior = behavior;
# ---------- slowdown: C# additional code ----------
  SlowDownBehavior behavior = new SlowDownBehavior();

  public class SlowDownBehavior : BehaviorBase
  {
    public double sightRadius = 1000;
    public double sightRotation = 45;
    public double pushRadius = 100;

    public override void Execute(AgentBase agent)
    {
      Boid boid = agent as Boid;

      if ( (bool) boid.CustomData["Gripping"] == false && (bool) boid.CustomData["beConnected"] == false && (bool) boid.CustomData["Wait"] == false )
      {
        Vector3d vel = boid.Velocity;
        Vector3d v = (Vector3d) boid.CustomData["Direction"];
        double angle = Vector3d.VectorAngle(vel, v);

        if (angle < Math.PI / 2)
        {

          // Create Sight of Robot
          List<Point3d> ptsSightTriangle = new List<Point3d>();
          v.Unitize();
          v = v * sightRadius;

          //Add
          ptsSightTriangle.Add(new Point3d(boid.Position.X, boid.Position.Y, boid.Position.Z));
          Vector3d z = new Point3d(boid.Position.X, boid.Position.Y, boid.Position.Z + 10) - boid.Position;
          v.Rotate(sightRotation, z);
          ptsSightTriangle.Add(new Point3d(boid.Position.X, boid.Position.Y, boid.Position.Z) + v);
          v.Rotate(-2 * sightRotation, z);
          ptsSightTriangle.Add(new Point3d(boid.Position.X, boid.Position.Y, boid.Position.Z) + v);
          v.Rotate(sightRotation, z);
          ptsSightTriangle.Add(new Point3d(boid.Position.X, boid.Position.Y, boid.Position.Z));

          PolylineCurve sight = new PolylineCurve(ptsSightTriangle);



          CartesianAgentSystem materialSystem = this.Solver.AgentSystems[0] as CartesianAgentSystem;

          for (int i = 0; i < materialSystem.Agents.Count; i++)
          {
            CartesianAgent materialAgent = materialSystem.Agents[i] as CartesianAgent;

            if (sight.Contains(materialAgent.Position) == PointContainment.Inside)
            {

              BoidSystem agentSystem = boid.AgentSystem as BoidSystem;
              double maxSpeed = agentSystem.MaxSpeed;


              Vector3d desired = materialAgent.Position - boid.Position;
              double d = desired.Length;
              desired.Unitize();
              if (d < sightRadius)
              {
                desired *= d / sightRadius * maxSpeed;
              } else
              {
                desired *= maxSpeed;
              }
              Vector3d steer = desired - boid.Velocity;
              if ((bool) materialAgent.CustomData["Collected"] == false)
              {
                boid.AddForce(steer);
              }
            }
          }
        }
      }
    }

  }


  /// <summary>
  /// This method will be called once every solution, before any calls to RunScript.
  /// </summary>
  public override void BeforeRunScript()
  { }
  /// <summary>
  /// This method will be called once every solution, after any calls to RunScript.
  /// </summary>
  public override void AfterRunScript()
  { }
# ---------- end slowdown ----------
pushing_dropping = CSharpScript(
    iRobotRadius=robot_radius_4,
    iMaterialRadius=material_radius_4,
    iHome=pt,
    Reference="\\MAC\HOME\DESKTOP\2023DF\AHIMOV\SOFTWARE\DATAVERSE_FILES\ABXM.CORE-1.4.0\ABMFRAMEWORK.CORE\ABxM.Core.dll")  # -> out, oBehavior; inputs iRobotRadius: Double, iMaterialRadius: Double, iHome: Point3d
# ---------- pushing_dropping: C# ----------
    behavior.pushRadius = iRobotRadius + iMaterialRadius;

    behavior.Home = iHome;

    oBehavior = behavior;
# ---------- pushing_dropping: C# additional code ----------
  MaterialDropBehavior behavior = new MaterialDropBehavior();

  public class MaterialDropBehavior : BehaviorBase
  {
    public double pushRadius = 100;
    public Point3d Home = new Point3d (0, 0, 0);


    public override void Execute(AgentBase agent)
    {
      Boid boid = agent as Boid;
      BoidSystem sys = (BoidSystem) boid.AgentSystem;

      if ( (bool) boid.CustomData["Gripping"] == true)
      {
        CartesianAgent material = (CartesianAgent) boid.CustomData["MaterialAgent"];

        if (boid.Position.DistanceTo(Home) < 500)
        {
          boid.CustomData["Gripping"] = false;
          boid.CustomData["MaterialAgent"] = false;
          boid.CustomData["Wait"] = false;
          material.CustomData["Moving"] = false;
          material.CustomData["Collected"] = true;
          material.CustomData["Home"] = true;
          boid.CustomData["beConnected"] = false;
          boid.CustomData["Connect"] = false;
          boid.CustomData["StopFinding"] = false;
          boid.CustomData["GripCount"] = 0;

          material.Position = boid.Position + (Vector3d) boid.CustomData["Direction"] * 2;

          boid.Velocity = -1 * boid.Velocity * 100000;
          boid.AddForce(boid.Velocity * 10000000000);

          List<Boid> neighbors = sys.FindNeighbors(boid, 600);
          for (int i = 0; i < neighbors.Count; i++)
          {
            if ( (bool) neighbors[i].CustomData["Connect"] == true)
            {
              neighbors[i].Velocity = boid.Velocity * 10000000000;
              neighbors[i].AddForce(boid.Velocity * 10000000000);


              neighbors[i].CustomData["Gripping"] = false;
              neighbors[i].CustomData["MaterialAgent"] = false;
              neighbors[i].CustomData["Wait"] = false;
              neighbors[i].CustomData["beConnected"] = false;
              neighbors[i].CustomData["Connect"] = false;
              neighbors[i].CustomData["StopFinding"] = false;
              neighbors[i].CustomData["GripCount"] = 0;

            }


            //neighbors[i].CustomData["Wait"] = false;
          }



          //return;
        }

      }
    }

  }


  /// <summary>
  /// This method will be called once every solution, before any calls to RunScript.
  /// </summary>
  public override void BeforeRunScript()
  { }
  /// <summary>
  /// This method will be called once every solution, after any calls to RunScript.
  /// </summary>
  public override void AfterRunScript()
  { }
# ---------- end pushing_dropping ----------
c_script_2 = CSharpScript(
    iHome=pt,
    iLenth="500",
    iRotation=robotsightrotation,
    Reference="\\MAC\HOME\DESKTOP\2023DF\AHIMOV\SOFTWARE\DATAVERSE_FILES\ABXM.CORE-1.4.0\ABMFRAMEWORK.CORE\ABxM.Core.dll")  # -> out, oBehavior; inputs iHome: Point3d, iLenth: Double, iRotation: Double
# ---------- c_script_2: C# ----------
    behavior.Lenth = iLenth;
    behavior.Rotation = iRotation;
    behavior.Home = iHome;
    oBehavior = behavior;
# ---------- c_script_2: C# additional code ----------
  public GoBackHomeBehavior behavior = new GoBackHomeBehavior();
  public class GoBackHomeBehavior : BehaviorBase
  {
    public double Rotation = 0;
    public double Lenth = 0;
    public Point3d Home = new Point3d(0, 0, 0);

    public override void Execute(AgentBase agent)
    {

      Boid boid = agent as Boid;
      BoidSystem sys = (BoidSystem) boid.AgentSystem;

      Vector3d goHome = Home - boid.Position;

      goHome.Unitize();
      Vector3d v = -goHome * Lenth;

      List<Point3d> ptsSightTriangle = new List<Point3d>();

      ptsSightTriangle.Add(new Point3d(boid.Position.X, boid.Position.Y, boid.Position.Z));
      Vector3d z = new Point3d(boid.Position.X, boid.Position.Y, boid.Position.Z + 10) - boid.Position;
      v.Rotate(Rotation, z);
      ptsSightTriangle.Add(new Point3d(boid.Position.X, boid.Position.Y, boid.Position.Z) + v);
      v.Rotate(-2 * Rotation, z);
      ptsSightTriangle.Add(new Point3d(boid.Position.X, boid.Position.Y, boid.Position.Z) + v);
      v.Rotate(Rotation, z);
      ptsSightTriangle.Add(new Point3d(boid.Position.X, boid.Position.Y, boid.Position.Z));

      PolylineCurve sight = new PolylineCurve(ptsSightTriangle);

      for (int i = 0; i < sys.Agents.Count; i++)
      {
        Boid robot = sys.Agents[i] as Boid;
        if (sight.Contains(robot.Position) == PointContainment.Inside && (bool) robot.CustomData["Connect"] == true)
        {
          //boid.CustomData["Wait"] = false;
          boid.CustomData["beConnected"] = true;
          boid.CustomData["Wait"] = false;
        }
      }

      if ((bool) boid.CustomData["beConnected"] == true && (bool) boid.CustomData["Gripping"] == true)
      {
        boid.AddForce(goHome * 100);
        boid.Velocity = goHome*20;
      }

    }
  }
# ---------- end c_script_2 ----------

material_radius_5 = Number(material_radius)
robot_radius_5 = Number(robot_radius)

# ---- group: Coloring behavior
number_slider_7 = Slider(0.02668, range=0..0.5)
swatch_2 = ColourSwatch(SwatchColor=RGB(255, 71, 255))
containment = CSharpScript(
    iColor=swatch_2,
    iMix=number_slider_7,
    Reference="\\MAC\HOME\DESKTOP\2023DF\AHIMOV\SOFTWARE\DATAVERSE_FILES\ABXM.CORE-1.4.0\ABMFRAMEWORK.CORE\ABxM.Core.dll")  # -> out, oBehavior; inputs iMix: Double
# ---------- containment: C# ----------
    behavior.MyColor = (System.Drawing.Color) iColor;
    behavior.MixingRatio = iMix;
    oBehavior = behavior;
# ---------- containment: C# additional code ----------
  ColorBehaviour behavior = new ColorBehaviour(1.0);

  public class ColorBehaviour : BehaviorBase
  {

    public System.Drawing.Color MyColor = System.Drawing.Color.Black;
    public double MixingRatio = 0.5;
    Random rand = new Random();

    public ColorBehaviour(double weight)
    {
      Weight = weight;
      //iBox = B;
    }

    public override void Execute(AgentBase agent)
    {
      Boid boid = agent as Boid;
      BoidSystem system = (BoidSystem) boid.AgentSystem;
      MeshEnvironment env = (MeshEnvironment) system.SurfEnvironment;
      Mesh mesh = env.Mesh;

      //get the vertices of the face on which the agent currently is
      MeshPoint point = mesh.ClosestMeshPoint(boid.Position, 0.0);
      int faceIndex = point.FaceIndex;
      //MeshFace face = mesh.Faces[faceIndex];

      int[] vertices = mesh.Faces.GetTopologicalVertices(faceIndex);

      //now add color to the vertices of the face
      foreach(int vertex in vertices)
      {
        System.Drawing.Color vertexColor = mesh.VertexColors[vertex];

        int newR = (int) ((1.0 - this.MixingRatio) * vertexColor.R + this.MixingRatio * this.MyColor.R);
        int newG = (int) ((1.0 - this.MixingRatio) * vertexColor.G + this.MixingRatio * this.MyColor.G);
        int newB = (int) ((1.0 - this.MixingRatio) * vertexColor.B + this.MixingRatio * this.MyColor.B);

        //        int newR = (int) (0.9 * vertexColor.R);
        //        int newG = (int) (0.9 * vertexColor.G);
        //        int newB = (int) (0.1 * (255 - vertexColor.B) + vertexColor.B);

        mesh.VertexColors.SetColor(vertex, newR, newG, newB);
      }
    }
  }
# ---------- end containment ----------

# ----
swatch_3 = ColourSwatch(SwatchColor=RGB(255, 255, 255))
list_length = ListLength(List=robots_in_use)

# ----
# Updates Direction Vector
# based on Velocity
toggle = BooleanToggle(True)
material_radius_6 = Number(material_radius)
robot_radius_6 = Number(robot_radius)
update_direction = CSharpScript(
    iActivate=toggle,
    iRobotRadius=robot_radius_6,
    iMaterialRadius=material_radius_6,
    Reference="\\MAC\HOME\DESKTOP\2023DF\AHIMOV\SOFTWARE\DATAVERSE_FILES\ABXM.CORE-1.4.0\ABMFRAMEWORK.CORE\ABxM.Core.dll")  # -> out, oBehavior; inputs iActivate: Boolean, iRobotRadius: Double, iMaterialRadius: Double
# ---------- update_direction: C# ----------
    behavior.active = iActivate;
    behavior.pushRadius = iRobotRadius + iMaterialRadius;
    oBehavior = behavior;
# ---------- update_direction: C# additional code ----------
  UpdateDirectionBehaviour behavior = new UpdateDirectionBehaviour();

  public class UpdateDirectionBehaviour : BehaviorBase
  {

    public bool active = false;
    public double pushRadius = 100;

    public override void Execute(AgentBase agent)
    {

      Boid boid = agent as Boid;
      BoidSystem sys = (BoidSystem) boid.AgentSystem;
      Vector3d velocity = boid.Velocity;
      Vector3d direction = (Vector3d) boid.CustomData["Direction"];


      if (velocity.Length > 0.001)
      {
        if (active)
        {

          Double angle = Vector3d.VectorAngle(direction, velocity);
          //RhinoApp.WriteLine(angle.ToString());
          velocity.Unitize();


          if (angle < Math.PI / 2)
          {
            boid.CustomData["Direction"] = velocity * (pushRadius + sys.MaxForce);
          }
          else
          {
            //boid.CustomData["Direction"] = -1 * velocity * (pushRadius - 2 * sys.MaxForce);


            double newAngle = RemapToExponentialScale(angle, 3.14, 1.57, 0.38, 1.8);

            Transform t1 = Transform.Rotation(newAngle, boid.Position);
            velocity.Transform(t1);

            boid.CustomData["Direction"] = -1 * velocity * (pushRadius - 2 * sys.MaxForce);
          }

        }

        else
        {
          boid.CustomData["Direction"] = velocity * (pushRadius + sys.MaxForce);
        }
      }

    }

    public double RemapToExponentialScale(double value, double inputMin, double inputMax, double outputMin, double outputMax)
    {
      // Normalize the input value within the range [0, 1]
      double normalizedValue = (value - inputMin) / (inputMax - inputMin);

      // Map the normalized value to the exponential scale
      double exponentialValue = Math.Pow(outputMax / outputMin, normalizedValue) * outputMin;

      return exponentialValue;
    }

  }
# ---------- end update_direction ----------

list_length_2 = ListLength(List=material_in_use)
point = Point(Point(2615.540233, 1845.177392, 0))
addition = Addition(A=robot_radius_5, B=material_radius_5)
xy_plane = XYPlane(Origin=point)
containment_2 = CSharpScript(
    iColor=swatch_2,
    Factor=Slider(0, range=0..0.5),
    iMix=number_slider_7,
    Reference="\\MAC\HOME\DESKTOP\2023DF\AHIMOV\SOFTWARE\DATAVERSE_FILES\ABXM.CORE-1.4.0\ABMFRAMEWORK.CORE\ABxM.Core.dll")  # -> out, oBehavior; inputs Factor: Double, iMix: Double
# ---------- containment_2: C# ----------
    behavior.MyColor = (System.Drawing.Color) iColor;
    behavior.MixingRatio = iMix;
    oBehavior = behavior;
    behavior.d = Factor;
# ---------- containment_2: C# additional code ----------
  ColorBehaviour behavior = new ColorBehaviour(1.0);

  public class ColorBehaviour : BehaviorBase
  {
    public double d = 0;
    public System.Drawing.Color MyColor = System.Drawing.Color.Black;
    public double MixingRatio = 0.5;
    Random rand = new Random();

    public ColorBehaviour(double weight)
    {
      Weight = weight;
      //iBox = B;
    }

    public override void Execute(AgentBase agent)
    {
      Boid boid = agent as Boid;
      BoidSystem system = (BoidSystem) boid.AgentSystem;
      MeshEnvironment env = (MeshEnvironment) system.SurfEnvironment;
      Dictionary<int,int> colours = (Dictionary<int,int>) env.CustomData["Colour"];

      Mesh mesh = env.Mesh;

      //get the vertices of the face on which the agent currently is
      MeshPoint point = mesh.ClosestMeshPoint(boid.Position, 0.0);
      int faceIndex = point.FaceIndex;
      int[] vertices = mesh.Faces.GetTopologicalVertices(faceIndex);

      //now add color to the vertices of the face
      foreach(int vertex in vertices)
      {
        colours[faceIndex] = colours[faceIndex] + 1;
        colours[faceIndex] = Math.Min(colours[faceIndex], 10);
        System.Drawing.Color vertexColor = mesh.VertexColors[vertex];
        int newR = (int) ((1.0 - this.MixingRatio) * vertexColor.R + this.MixingRatio * this.MyColor.R);
        int newG = (int) ((1.0 - this.MixingRatio) * vertexColor.G + this.MixingRatio * this.MyColor.G);
        int newB = (int) ((1.0 - this.MixingRatio) * vertexColor.B + this.MixingRatio * this.MyColor.B);
        mesh.VertexColors.SetColor(vertex, newR, newG, newB);
      }

      //RhinoApp.WriteLine(colours[faceIndex].ToString());
      //add force to agent by the colour[vertex]
      //Vector3d meshdirection = boid.Position - point.Point;

      if((bool) boid.CustomData["Wait"] == false && (bool) boid.CustomData["Connect"] == false && (bool) boid.CustomData["beConnected"] == false)
      {
        Vector3d meshdirection = FindLargestVector(colours, mesh, boid.Position, 200);
        meshdirection.Unitize();
        boid.AddForce(meshdirection * d * colours[faceIndex]);
      }


      //      MeshPoint meshnbpoint = mesh.ClosestMeshPoint(boid.Position, 200.0);
      //      int meshfaceIndex = meshnbpoint.FaceIndex;
      //
      //      int[] meshvertices = mesh.Faces.GetTopologicalVertices(meshfaceIndex);
      //
      //      foreach(int meshvertex in meshvertices)
      //      {
      //        Vector3d meshdirection = meshnbpoint.Position - boid.Velocity;
      //        meshdirection.Unitize();
      //        Point3d newPosition = boid.Position + colour[meshvertex] * meshdirection * d;
      //      }
    }

    public static Vector3d FindLargestVector(Dictionary<int,int> Faces, Mesh mesh, Point3d agentPosition, double radius)
    { // Create an RTree and populate it with vertex points
      RTree rTree = new RTree();
      for (int i = 0; i < mesh.Faces.Count; i++)
      {
        Point3d faceCenter = mesh.Faces.GetFaceCenter(i);
        rTree.Insert(faceCenter, i);
      }
      // Search for points within the radius around the agent position
      Sphere searchSphere = new Sphere(agentPosition, radius);
      List<int> vertexIndices = new List<int>();
      rTree.Search(searchSphere, (sender, e) => vertexIndices.Add(e.Id));

      // Find the largest value among the associated dictionaries
      int largestValue = int.MinValue;
      foreach (int vertexIndex in vertexIndices)
      {
        int value = Faces[vertexIndex];
        if (value > largestValue) largestValue = value;
      }



      return mesh.Faces.GetFaceCenter(largestValue) - agentPosition;
    }
  }
# ---------- end containment_2 ----------
multiplication = Multiplication(A=addition, B="2.2")

# ----
# MOBILE ROBOT
# BASIC BEHAVIORS
boundary_2 = Curve(crv)
c_script_3 = CSharpScript(
    W=Slider(0.001, range=0..0.9),
    Reference="\\MAC\HOME\DESKTOP\2023DF\AHIMOV\SOFTWARE\DATAVERSE_FILES\ABXM.CORE-1.4.0\ABMFRAMEWORK.CORE\ABxM.Core.dll")  # -> out, oBehavior; inputs W: Double
# ---------- c_script_3: C# usings ----------
using ABxM.Core.Behavior;
using ABxM.Core.Agent;
using ABxM.Core.Environments;
using ABxM.Core.AgentSystem;

using System.Reflection;
using Rhino.Display;
using System.Drawing;
# ---------- c_script_3: C# ----------
    SeekAndWanderBehavior behavior = new SeekAndWanderBehavior(W);

    oBehavior = behavior;
# ---------- c_script_3: C# additional code ----------
  public class SeekAndWanderBehavior : BehaviorBase
  {
    Random rand = new Random();


    public SeekAndWanderBehavior(double weight) : base()
    {
      Weight = weight;
    }


    public override void Execute(AgentBase agent)
    {
      Boid bot = (Boid) agent;
      ReynoldsWander(bot, 10, 2.0);
    }

    public void ReynoldsWander(AgentBase agent, double distance, double radius)
    {
      Boid boid = agent as Boid;

      //======================================================================================================
      // Task: Compute the "force" vector caused by this behavior and add it to the list "locoAgent.Force"
      //======================================================================================================

      Vector3d direction = boid.Velocity;
      direction.Unitize();
      Point3d newPosition = boid.Position + distance * direction;
      double theta = rand.NextDouble() * 2 * Math.PI;

      double xVal = radius * Math.Cos(theta);
      double yVal = radius * Math.Sin(theta);
      Point3d polar = new Point3d(xVal, yVal, 0);
      Point3d target = newPosition + polar;

      Vector3d desired = target - boid.Position;
      Vector3d steering = desired - boid.Velocity;



      if ((bool) boid.CustomData["Wait"] == false && (bool) boid.CustomData["Connect"] == false
        )
      {
        boid.AddForce(steering);
      }


    }

  }
# ---------- end c_script_3 ----------
separate = DefineSeparationBehavior(SeparationDistance=multiplication, Weight=Slider(3, range=0..5), Power=1, AffectSelf=True)

number_slider_8 = Slider(0.9, range=0..1)
area = Area(Geometry=boundary_2)  # -> Area, Centroid
scale_nu = ScaleNU(Geometry=boundary_2, Plane=area.Centroid, ScaleX=number_slider_8, ScaleY=number_slider_8, ScaleZ=1)  # -> Geometry, Transform
containment_3 = CSharpScript(
    R=scale_nu.Geometry,
    D=D,
    W=Slider(200, range=0..1000),
    Reference="\\MAC\HOME\DESKTOP\2023DF\AHIMOV\SOFTWARE\DATAVERSE_FILES\ABXM.CORE-1.4.0\ABMFRAMEWORK.CORE\ABxM.Core.dll")  # -> out, oBehavior; inputs R: Rectangle3d, D: Double, W: Double
# ---------- containment_3: C# ----------
    behavior.Weight = W;
    behavior.Rectangle = R;
    behavior.Distance = D;
    oBehavior = behavior;
# ---------- containment_3: C# additional code ----------
  RectangleContainmentBehaviour behavior = new RectangleContainmentBehaviour(1.0);

  public class RectangleContainmentBehaviour : BehaviorBase
  {

    public Rectangle3d Rectangle = Rectangle3d.Unset;
    public double Distance = 0;

    public RectangleContainmentBehaviour(double weight)
    {
      Weight = weight;
      //iBox = B;
    }

    public override void Execute(AgentBase agent)
    {
      Boid boid = agent as Boid;

      //======================================================================================================
      // Task: Compute the "force" vector caused by this behavior and add it to the list "locoAgent.Force"
      //======================================================================================================

      Point3d newPosition = boid.Position + boid.Velocity;
      Vector3d desired = boid.Velocity;
      Vector3d steering = Vector3d.Unset;
      Vector3d transVt = Vector3d.Unset;

      /*
      "To implement: first predict our character’s future position, if it is inside the allowed region
      no corrective steering is necessary. Otherwise we steer towards the allowed region." (Reynolds 1999)
      */

      if (Rectangle.IsValid){
        if (Rectangle.Contains((newPosition)) == PointContainment.Outside)
        {
          // project new position onto boundary
          Point3d projPt = Rectangle.ClosestPoint(newPosition);
          // extend position by to obtain new target point
          //Vector3d transVt = Vector3d.Subtract(projPt, newPosition).Unitize();
          transVt = (Vector3d) (projPt - newPosition);
          transVt.Unitize();
          steering = transVt;
          boid.AddForce(steering * Weight);
          
          Point3d target = Distance * transVt + projPt; // offset target point from boundary
          desired = target - boid.Position;
        }
      }
    }
  }
# ---------- end containment_3 ----------

# ----
# MATERIAL
# BEHAVIORS
boundary_scaled = Curve(scale_nu.Geometry)
addition_2 = Addition(A=list_length, B=list_length_2)
c_script_4 = CSharpScript(
    D=number_slider_5,
    sD=number_slider_6,
    Reference="\\MAC\HOME\DESKTOP\2023DF\AHIMOV\SOFTWARE\DATAVERSE_FILES\ABXM.CORE-1.4.0\ABMFRAMEWORK.CORE\ABxM.Core.dll")  # -> oBehavior, A; inputs D: Double, sD: Double
# ---------- c_script_4: C# ----------
    //

    behavior.distence = D;
    behavior.stopdistence = sD;
    oBehavior = behavior;
# ---------- c_script_4: C# additional code ----------
  public FindNeighborBehavior behavior = new FindNeighborBehavior();

  public class FindNeighborBehavior : BehaviorBase
  {

    public double distence = 10;
    public double stopdistence = 10;
    public double len = 0;

    public override void Execute(AgentBase agent)
    {
      Boid boid = agent as Boid;
      BoidSystem sys = (BoidSystem) boid.AgentSystem;

      Vector3d r = new Vector3d(0, 0, 0);

      List<Boid> neighbors = sys.FindNeighbors(boid, distence);

      if (neighbors.Count > 0 && (bool) boid.CustomData["Wait"] == false && (bool) boid.CustomData["beConnected"] == false)
      {
        for (int i = 0; i < neighbors.Count; i++)
        {
          Vector3d newderection = (neighbors[i] as Boid).Position - boid.Position;
          Vector3d tarderection = newderection - boid.Velocity;
          if ((bool) neighbors[i].CustomData["beConnected"] == true)
          {
            tarderection.Unitize();
            boid.Velocity = tarderection * 8;
            return;
          }

          
          if ((bool) neighbors[i].CustomData["Wait"] == true)
          {
            boid.CustomData["StopFinding"] = true;
            //hadOne = true;
            boid.Velocity = tarderection;



            double len = newderection.Length;
            if (len < stopdistence)
            {
              //boid.Velocity = new Vector3d(0, 0, 0);
              boid.CustomData["Connect"] = true;

              Vector3d up = new Point3d(neighbors[i].Position.X, neighbors[i].Position.Y, neighbors[i].Position.Z + 5) - neighbors[i].Position;
              r = boid.Position - neighbors[i].Position;
              r.Rotate(0.5 * Math.PI, up);
              r.Unitize();
              tarderection.Unitize();
              boid.Velocity = 100 * r;
            }

          }

        }
      }




    }

  
}
# ---------- end c_script_4 ----------
duplicate_data = DuplicateData(Data=xy_plane, Number=addition_2, Order=True)
pt_2 = Point([<point referenced from the Rhino model> x3])
integer = Integer(robots_in_use)
integer_2 = Integer(material_in_use)

run_solver = BooleanToggle(False)
reset_solver = Button()

number_slider_9 = Slider(0, range=0..11)
merge = Merge()  # -> flatten(Result)

# ----
# MATERIAL
# AGENT
pop2d = Populate2D(Region=boundary_scaled, Count=material_count, Seed=Slider(38, range=0..100))
cartesian_agent = DefineCartesianAgent(Positions=pop2d, Behaviors=merge)
c_script_5 = CSharpScript(
    iReset=reset_solver,
    iAgents=cartesian_agent,
    Reference="\\MAC\HOME\DESKTOP\2023DF\AHIMOV\SOFTWARE\DATAVERSE_FILES\ABXM.CORE-1.4.0\ABMFRAMEWORK.CORE\ABxM.Core.dll")  # -> out, A; inputs iReset: Boolean, iAgents: list
# ---------- c_script_5: C# usings ----------
using ABxM.Core.Agent;
# ---------- c_script_5: C# ----------
    foreach(CartesianAgent agent in iAgents)
    {


      if(!agent.CustomData.ContainsKey("Moving"))
      {
        agent.CustomData.Add("Moving", false);
      }
      if(agent.CustomData["Moving"] == null || iReset)
      {
        agent.CustomData["Moving"] = false;
      }


      if(!agent.CustomData.ContainsKey("Collected"))
      {
        agent.CustomData.Add("Collected", false);
      }
      if(agent.CustomData["Collected"] == null || iReset)
      {
        agent.CustomData["Collected"] = false;
      }
      
      if(!agent.CustomData.ContainsKey("Home"))
      {
        agent.CustomData.Add("Home", false);
      }
      if(agent.CustomData["Home"] == null || iReset)
      {
        agent.CustomData["Home"] = false;
      }



    }
    A = iAgents;
# ---------- end c_script_5 ----------

merge_2 = Merge(
    Data2=c_script_3.oBehavior,
    Data3=containment_2.oBehavior,
    Data4=slowdown.oBehavior,
    Data5=separate,
    Data6=containment_3.oBehavior,
    Data7=pickpush.oBehavior,
    Data8=c_script.oBehavior,
    Data9=c_script_2.oBehavior,
    Data10=pushing_dropping.oBehavior,
    Data11=update_direction.oBehavior)

# ----
# MATERIAL
# AGENT SYSTEM
cartesian_sys = DefineCartesianAgentSystem(CartesianAgents=c_script_5.A)

number_slider_10 = Slider(60, range=0..2000)
boundary_3 = BoundarySurfaces(Edges=crv)
mesh_uv = MeshSurface(Surface=boundary_3, UCount=number_slider_10, VCount=number_slider_10, Overhang=True, Equalize=False)

# ----
# ENVIRONMENT
mesh = Mesh(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)
demesh = DeconstructMesh(Mesh=mesh)  # -> Vertices, Faces, Colours, Normals; disabled
pt_3 = Point(Point(1097.22328, 1435.193063, 0))  # disabled
dist = Distance(PointA=pt_3, PointB=demesh.Vertices)  # disabled
sort = SortList(Keys=dist, ValuesA=dist)  # -> Keys, ValuesA; disabled
item = ListItem(List=reverse(sort.ValuesA), Index=0, Wrap=True)  # disabled
gradient = Gradient(
    LowerLimit=0,
    UpperLimit=item,
    Parameter=dist,
    stops=[0.28: RGB(255, 255, 0), 0.405: RGB(65, 105, 225), 0.856: RGB(255, 0, 0)])  # disabled
mcol = MeshColours(Mesh=mesh_uv, Colours=ColourSwatch(SwatchColor=RGB(0, 0, 0)))
c_script_6 = CSharpScript(
    M=mcol,
    Reference="\\MAC\HOME\DESKTOP\2023DF\AHIMOV\SOFTWARE\DATAVERSE_FILES\ABXM.CORE-1.4.0\ABMFRAMEWORK.CORE\ABxM.Core.dll")  # -> out, oMesh; inputs M: Mesh
# ---------- c_script_6: C# usings ----------
using ABxM.Core.Environments;
# ---------- c_script_6: C# ----------
    oMesh = new MeshEnvironment(M);
# ---------- end c_script_6 ----------

mesh_colored = Mesh(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)  # disabled
c_script_7 = CSharpScript(
    M=mcol,
    iReset=reset_solver,
    Reference="\\MAC\HOME\DESKTOP\2023DF\AHIMOV\SOFTWARE\DATAVERSE_FILES\ABXM.CORE-1.4.0\ABMFRAMEWORK.CORE\ABxM.Core.dll")  # -> out, oMesh; inputs M: Mesh, iReset: Boolean
# ---------- c_script_7: C# ----------
    MeshEnvironment env = new MeshEnvironment(M);

    Dictionary<int,int> colours = new Dictionary<int,int>();

    for (int i = 0; i < M.Faces.Count; i++)
    {
      colours.Add(i, 0);
    }

    if (!env.CustomData.ContainsKey("Colour"))
    {
      env.CustomData.Add("Colour", colours);
    }
    if (env.CustomData["Colour"] == null || iReset)

    {

      for (int i = 0; i < colours.Count; i++)
      {
        colours[i] = 0;
      }
      env.CustomData["Colour"] = colours;


    }

    oMesh = env;
# ---------- end c_script_7 ----------
panel = Panel(material_count)
number_slider_11 = Slider(100, range=0..100)
Y = UnitY(Factor=Slider(144, range=0..1000))
Y_2 = UnitY(Factor=Slider(71, range=0..100))
pt_4 = Point(<point referenced from the Rhino model>)
neg = Negative(Value=Y)
neg_2 = Negative(Value=Y_2)
move = Move(Geometry=pt_4, Motion=neg)  # -> Geometry, Transform
list_length_3 = ListLength(List=robots_in_use)
series = Series(Start=0, Step=1, Count=list_length_3)
concatenate = Concatenate(FragmentA="0", FragmentC=",", FragmentB="0")

pt_5 = Point(<point referenced from the Rhino model>)
cir = Circle(Plane=pt_5, Radius=Slider(180, range=0..1000))
boundary_4 = BoundarySurfaces(Edges=cir)
preview = CustomPreview(Geometry=boundary_4, Material=ColourSwatch(SwatchColor=RGB(233, 240, 48)))

circle = CircleCNR(Center=pt, Normal=Vector(0, 0, 1), Radius=Slider(600, range=0..1000))
rec = Rectangle(crv)

srf = Surface([<surface referenced from the Rhino model> x2])
debrep = DeconstructBrep(Brep=[srf, rec])  # -> Faces, Edges, Vertices
previewlw = CustomPreviewLineweights(
    Geometry=debrep.Edges,
    Shader=ColourSwatch(SwatchColor=RGB(255, 255, 255)),
    Thickness=Slider(20, range=0..100),
    Absolute=True)

rec_2 = Rectangle({Plane=PlaneXY(225.8424624, -2170.202424, -569.7573307), Size=Domain2(u=-5745.133205..5745.133205, v=-4219.376518..4219.376518)})
mesh_2 = Mesh(circle)
mesh_3 = Mesh(rec_2)

tag = TextTag3D(
    Location=pt_5,
    Text=number_slider_9,
    Size=Slider(100, range=0..100),
    Colour=ColourSwatch(SwatchColor=RGB(0, 0, 0)),
    Justification=5)

preview_2 = CustomPreview(Geometry=mesh_3, Material=ColourSwatch(SwatchColor=RGB(0, 0, 0)))
preview_3 = CustomPreview(Geometry=mesh_2, Material=ColourSwatch(SwatchColor=RGBA(230, 0, 255, 111)))

# ----
# MOBILE ROBOT
# AGENT
pop2d_2 = Populate2D(Region=boundary, Count=agent_count, Seed="8")
lng = ListLength(List=pop2d_2)
c_script_8 = CSharpScript(iCount=lng)  # -> out, A, B, C; inputs iCount: Int32
# ---------- c_script_8: C# ----------
    List<double> X = new List<double>();
    List<double> Y = new List<double>();
    List<double> Z = new List<double>();
    Random random = new Random(10);
    double range = 0.1;
    for (int i = 0; i < iCount; i++){
      X.Add(range * (random.NextDouble() * 2000.0 - 1000.0));
      Y.Add(range * (random.NextDouble() * 2000.0 - 1000.0));
      Z.Add(range * (random.NextDouble() * 2000.0 - 1000.0));
    }
    A = X;
    B = Y;
    C = Z;
# ---------- end c_script_8 ----------
vec = VectorXYZ(XComponent=c_script_8.A, YComponent=c_script_8.B, ZComponent=0)  # -> Vector, Length

panel_2 = Panel(name)
xy_plane_2 = XYPlane(Origin=Point(0, 0, 0))
project = Project(Geometry=plane, Plane=xy_plane_2)  # -> Geometry, Transform

null_item = NullItem(Item=project.Geometry)  # -> NullFlags, InvalidFlags, Description
pick_n_choose = PickNChoose(Pattern=null_item.NullFlags, Stream0=project.Geometry, Stream1=duplicate_data)
ghpython_script = GhPythonScript(iRobotID=integer, iMaterialID=integer_2, iRigidBodyNames=name, iOptiPlanes=pick_n_choose)  # -> out, flatten(oRobotPlanes), flatten(oMaterialPlanes); inputs iReset: tree of Boolean, iRobotID: list of Int32, iMaterialID: list of Int32, iRigidBodyNames: list, iOptiPlanes: list of Plane
# ---------- ghpython_script: Python ----------
__author__ = "samue"
__version__ = "2022.11.22"

import System
import Rhino.Geometry as rg
from collections import deque
from Grasshopper import DataTree
import Grasshopper.Kernel.Data.GH_Path as ghpath


oRobotPlanes = DataTree[System.Object]()
oMaterialPlanes = DataTree[System.Object]()

if iReset:
    if iRobotID != [None]:
        for x in range(len(iRobotID)):
            oRobotPlanes.Add(rg.Plane.WorldXY, ghpath(iRobotID[x]))
    if iMaterialID != [None]:
        for x in range(len(iMaterialID)):
            oMaterialPlanes.Add(rg.Plane.WorldXY, ghpath(iMaterialID[x]))



for x in range(len(iRigidBodyNames)):
    st = iRigidBodyNames[x]

    first = st[0]
    if iRobotID != [None]:
        if first == "R":
            last = st[len("ROBOT_"):]
            last = int(last)
            oRobotPlanes.RemovePath(last)
            oRobotPlanes.Add(iOptiPlanes[x], ghpath(last))

    if iMaterialID != [None]:
        if first == "M":
            last = st[len("MATERIAL_"):]
            last = int(last)
            oMaterialPlanes.RemovePath(last)
            oMaterialPlanes.Add(iOptiPlanes[x], ghpath(last))
# ---------- end ghpython_script ----------
panel_3 = Panel(pick_n_choose)
flip_plane_2 = FlipPlane(Plane=ghpython_script.oRobotPlanes, ReverseX=False, ReverseY=True, SwapAxes=False)
panel_4 = Panel(ghpython_script.oMaterialPlanes)

point_2 = Point(ghpython_script.oMaterialPlanes)

plane_2 = Plane(flip_plane_2)
plane_3 = Plane(ghpython_script.oMaterialPlanes)

# ----
# ROBOT VECTOR CALCULATION
deconstruct_plane = DeconstructPlane(Plane=plane_2)  # -> Origin, XAxis, YAxis, ZAxis

# ----
# UPDATE POSITIONS
optitrack_active = Boolean(Toggle(False))
material_radius_7 = Number(material_radius)
vector = Vector(deconstruct_plane.YAxis)
robot_radius_7 = Number(robot_radius)
point_3 = Point(deconstruct_plane.Origin)
update_direction_2 = CSharpScript(
    iActivate=optitrack_active,
    iRobotRadius=robot_radius_7,
    iMaterialRadius=material_radius_7,
    iPosRob=point_3,
    iOrientRob=vector,
    iPosMaterial=point_2,
    Reference="\\MAC\HOME\DESKTOP\2023DF\AHIMOV\SOFTWARE\DATAVERSE_FILES\ABXM.CORE-1.4.0\ABMFRAMEWORK.CORE\ABxM.Core.dll")  # -> out, oBehavior; inputs iActivate: Boolean, iRobotRadius: Double, iMaterialRadius: Double, iPosRob: list of Point3d, iOrientRob: list of Vector3d, iPosMaterial: list of Point3d
# ---------- update_direction_2: C# ----------
    behavior.active = iActivate;
    behavior.pushRadius = iRobotRadius + iMaterialRadius;
    behavior.PositionsRob = iPosRob;
    behavior.RobotDirection = iOrientRob;
    behavior.PositionsMaterial = iPosMaterial;
    oBehavior = behavior;
# ---------- update_direction_2: C# additional code ----------
  UpdateDirectionBehaviour behavior = new UpdateDirectionBehaviour();

  public class UpdateDirectionBehaviour : BehaviorBase
  {

    public bool active = false;
    public double pushRadius = 100;

    public List<Point3d> PositionsRob = new List<Point3d>();
    public List<Vector3d> RobotDirection = new List<Vector3d>();
    
    public List<Point3d> PositionsMaterial = new List<Point3d>();

    public override void Execute(AgentBase agent)
    {
      if (active)
      {
        Boid boid = agent as Boid;
        BoidSystem sys = (BoidSystem) boid.AgentSystem;

        int id = agent.Id;
        if (id < PositionsRob.Count){

          (agent as Boid).Position = PositionsRob[id];
          Vector3d velocity = RobotDirection[id];
          velocity.Unitize();
          (agent as Boid).CustomData["Direction"] = velocity * (pushRadius + sys.MaxForce);

          if (id == 0)
          {
            CartesianAgentSystem materialSystem = this.Solver.AgentSystems[0] as CartesianAgentSystem;
              
            for (int i = 0; i < PositionsMaterial.Count; i++)
            {
              CartesianAgent material = materialSystem.Agents[i] as CartesianAgent;
              material.Position = PositionsMaterial[i];
            }
          }
        }

      }
    }
  }
# ---------- end update_direction_2 ----------

# ----
# MOBILE ROBOT
# AGENT SYSTEM
number_slider_12 = Slider(10, range=0..1000)

num = Number(number_slider_12)

amp = Amplitude(Vector=vec.Vector, Amplitude=num)
boid = DefineBoid(Positions=pop2d_2, Velocities=amp, Behaviors=flatten(merge_2))
c_script_9 = CSharpScript(
    iReset=reset_solver,
    iAgents=boid,
    iDirection=amp,
    Reference="\\MAC\HOME\DESKTOP\2023DF\AHIMOV\SOFTWARE\DATAVERSE_FILES\ABXM.CORE-1.4.0\ABMFRAMEWORK.CORE\ABxM.Core.dll")  # -> out, A; inputs iReset: Boolean, iAgents: list, iDirection: list of Vector3d
# ---------- c_script_9: C# ----------
    for (int i = 0; i < iAgents.Count; ++i)
      //foreach(Boid agent in iAgents)
    {
      Boid agent = iAgents[i] as Boid;

      if(!agent.CustomData.ContainsKey("Gripping"))
      {
        agent.CustomData.Add("Gripping", false);
      }
      if(agent.CustomData["Gripping"] == null || iReset)
      {
        agent.CustomData["Gripping"] = false;
      }


      if(!agent.CustomData.ContainsKey("MaterialAgent"))
      {
        agent.CustomData.Add("MaterialAgent", false);
      }
      if(agent.CustomData["MaterialAgent"] == null || iReset)
      {
        agent.CustomData["MaterialAgent"] = false;
      }

      if(!agent.CustomData.ContainsKey("Direction"))
      {
        agent.CustomData.Add("Direction", iDirection[i]);
      }
      if(agent.CustomData["Direction"] == null || iReset)
      {
        agent.CustomData["Direction"] = iDirection[i];
      }

      if(!agent.CustomData.ContainsKey("Wait"))
      {
        agent.CustomData.Add("Wait", false);
      }
      if(agent.CustomData["Wait"] == null || iReset)
      {
        agent.CustomData["Wait"] = false;
      }

      if(!agent.CustomData.ContainsKey("Connect"))
      {
        agent.CustomData.Add("Connect", false);
      }
      if(agent.CustomData["Connect"] == null || iReset)
      {
        agent.CustomData["Connect"] = false;
      }

      if(!agent.CustomData.ContainsKey("beConnected"))
      {
        agent.CustomData.Add("beConnected", false);
      }
      if(agent.CustomData["beConnected"] == null || iReset)
      {
        agent.CustomData["beConnected"] = false;
      }

      //==================================================================



      if(!agent.CustomData.ContainsKey("StopFinding"))
      {
        agent.CustomData.Add("StopFinding", false);
      }
      if(agent.CustomData["StopFinding"] == null || iReset)
      {
        agent.CustomData["StopFinding"] = false;
      }

      if(!agent.CustomData.ContainsKey("GripCount"))
      {
        agent.CustomData.Add("GripCount", 0);
      }
      if(agent.CustomData["GripCount"] == null || iReset)
      {
        agent.CustomData["GripCount"] = 0;
      }

      A = iAgents;
    }
# ---------- end c_script_9 ----------

boid_system = CSharpScript(
    iAgents=c_script_9.A,
    iEnvironment=c_script_7.oMesh,
    iThreshold="0.00001",
    iTimeStep=Slider(0.7, range=0..1),
    iMaxSpeed=number_slider_12,
    iMaxForce=number_slider_12,
    Reference="\\MAC\HOME\DESKTOP\2023DF\AHIMOV\software\dataverse_files\ABxM.Core-1.4.0\AbmFramework.Core\ABxM.Core.dll")  # -> out, oAgentSystem; inputs iAgents: list, iThreshold: Double, iTimeStep: Double, iMaxSpeed: Double, iMaxForce: Double
# ---------- boid_system: C# ----------
    List<Boid> agents = new List<Boid>();
    //foreach (AgentBase agent in iAgents)
    for (int i = 0; i < iAgents.Count; i++)
    {
      Boid a = iAgents[i] as Boid;
      a.Id = i;
      agents.Add(a);
    }

    BoidSystem asB = new BoidSystem(agents);
    asB.MaxSpeed = iMaxSpeed;
    asB.MaxForce = iMaxForce;
    asB.DisplacementThreshold = iThreshold;
    asB.TimeStep = iTimeStep;
    asB.SurfEnvironment = iEnvironment as MeshEnvironment;
    oAgentSystem = asB;
# ---------- end boid_system ----------

integer_3 = Integer(number_slider_12)

plane_4 = Plane(plane_2)
min = Slider(11, range=0..254)
max = Slider(169, range=0..254)

cluster = Cluster()  # -> x, panel
pt_6 = Point(Point(-2746.997655, -3463.295083, 0))
concat = Concatenate(FragmentA=cluster.x, FragmentB=cluster.panel)
panel_5 = Panel(concat)
xy = XYPlane(Origin=pt_6)
rotate = Rotate(Geometry=xy, Angle=degrees(Slider(0, range=-180..180)), Plane=xy)  # -> Geometry, Transform
rectangle = Rectangle(Plane=PlaneXY(0, 0, 0), XSize=Slider(715, range=0..1000), YSize=Slider(92, range=0..1000), Radius=0)  # -> Rectangle, Length
arrrec = RectangularArray(Geometry=rotate.Geometry, Cell=rectangle.Rectangle, XCount=Slider(2, range=0..10), YCount=Slider(5, range=0..10))  # -> Geometry, Transform
flip = FlipMatrix(Data=arrrec.Geometry)

pt_7 = Point(Point(-2764.950153, -3448.295087, 0))  # disabled
panel_6 = Panel("Drone Direction:")  # disabled
panel_7 = Panel("Picking A Material:")  # disabled
panel_8 = Panel("Drone Position:")  # disabled
panel_9 = Panel("Drone Velocity:")  # disabled
panel_10 = Panel("")  # disabled
number_slider_13 = Slider(0, range=-180..180)  # disabled
number_slider_14 = Slider(35, range=0..100)  # disabled
xy_2 = XYPlane(Origin=pt_7)  # disabled
swatch_4 = ColourSwatch(SwatchColor=RGB(255, 255, 255))  # disabled
rotate_2 = Rotate(Geometry=xy_2, Angle=degrees(number_slider_13), Plane=xy_2)  # -> Geometry, Transform; disabled
number_slider_15 = Slider(67, range=0..1000)  # disabled
number_slider_16 = Slider(446, range=0..1000)  # disabled
number_slider_17 = Slider(2, range=0..10)  # disabled
number_slider_18 = Slider(4, range=0..10)  # disabled
rectangle_2 = Rectangle(Plane=PlaneXY(0, 0, 0), XSize=number_slider_16, YSize=number_slider_15, Radius=0)  # -> Rectangle, Length; disabled
arrrec_2 = RectangularArray(Geometry=rotate_2.Geometry, Cell=rectangle_2.Rectangle, XCount=number_slider_17, YCount=number_slider_18)  # -> Geometry, Transform; disabled
flip_2 = FlipMatrix(Data=arrrec_2.Geometry)  # disabled

# ----
# SOLVER
run_solver_2 = Boolean(run_solver)
merge_3 = Merge(Data1=flatten(cartesian_sys), Data2=flatten(boid_system.oAgentSystem))
reset_solver_2 = Boolean(reset_solver)

solver = StepByStepSolver(Reset=reset_solver_2, Execute=run_solver_2, AgentSystems=merge_3)  # -> DisplayGeometries, AllAgentSystems, IterationCount

visualize = CSharpScript(
    iAgentSystem=solver.AllAgentSystems,
    Reference="\\MAC\HOME\DESKTOP\2023DF\AHIMOV\SOFTWARE\DATAVERSE_FILES\ABXM.CORE-1.4.0\ABMFRAMEWORK.CORE\ABxM.Core.dll")  # -> out, oRobotPositions, oRobotVelocities, oRobotDirection, oNear, oMaterial, oMesh, oCollected, oWait; inputs iAgentSystem: list
# ---------- visualize: C# usings ----------
using System.Drawing;
using System.Windows.Markup;
using ABxM.Core;
using ABxM.Core.Agent;
using ABxM.Core.AgentSystem;
using ABxM.Core.Behavior;
using ABxM.Core.Environments;
# ---------- visualize: C# ----------
    robotSystem = iAgentSystem[1] as BoidSystem;
    materialSystem = iAgentSystem[0] as CartesianAgentSystem;

    List<Point3d> robotPositions = new List<Point3d>();
    List<Vector3d> robotVelocites = new List<Vector3d>();
    List<Vector3d> robotDirctions = new List<Vector3d>();
    List<bool> near = new List<bool>();
    List<bool> collected = new List<bool>();
    List<bool> wait = new List<bool>();

    List<Point3d> materialPositions = new List<Point3d>();

    for (int i = 0; i < robotSystem.Agents.Count; i++)
    {
      robotPositions.Add((robotSystem.Agents[i] as Boid).Position);
      robotVelocites.Add((robotSystem.Agents[i] as Boid).Velocity);
      near.Add((bool) (robotSystem.Agents[i] as Boid).CustomData["Gripping"]);
      wait.Add((bool) (robotSystem.Agents[i] as Boid).CustomData["Wait"]);
      robotDirctions.Add((Vector3d) (robotSystem.Agents[i] as Boid).CustomData["Direction"]);
      //Print((robotSystem.Agents[i] as Boid).CustomData["Near"]);
    }

    for (int i = 0; i < materialSystem.Agents.Count; i++)
    {
      materialPositions.Add((materialSystem.Agents[i] as CartesianAgent).Position);
      collected.Add((bool) (materialSystem.Agents[i] as CartesianAgent).CustomData["Home"]);
    }

    MeshEnvironment myEnv = (MeshEnvironment) robotSystem.SurfEnvironment;

    oRobotPositions = robotPositions;
    oRobotVelocities = robotVelocites;
    oNear = near;
    oMaterial = materialPositions;
    oMesh = myEnv.Mesh;
    oRobotDirection = robotDirctions;
    oCollected = collected;
    oWait = wait;
# ---------- visualize: C# additional code ----------
  private BoidSystem robotSystem;
  private CartesianAgentSystem materialSystem;
# ---------- end visualize ----------

point_4 = Point(visualize.oRobotPositions)
ghpython_script_2 = GhPythonScript(target=point_4, robotPlane=plane_4, maxSpeedSim=integer_3, outputSpeedMax=max, outputSpeedMin=min)  # -> out, rights, lefts; inputs target: list of Point3d, robotPlane: list of Plane, maxSpeedSim: Int32, outputSpeedMax: Int32
# ---------- ghpython_script_2: Python ----------
import Rhino.Geometry as rg
import math

def map(v, in_min, in_max, out_min, out_max):
	# Check that the value is at least in_min
	if v < in_min:
		v = in_min
	# Check that the value is at most in_max
	if v > in_max:
		v = in_max
	return (v - in_min) * (out_max - out_min) // (in_max - in_min) + out_min

right = 0
left = 0

rights =[]
lefts = []

if target:
    for i in range(len(robotPlane)):
        if robotPlane[i] == None:
            robotPlane[i] = rg.Plane(target[i],rg.Vector3d.XAxis)
            
        pt = rg.Plane.RemapToPlaneSpace(robotPlane[i],target[i])
        
        x = pt[1].X
        y = pt[1].Y
        
        if x != 0 and y != 0:
            # compute angle within robot plane
            z = math.sqrt(x * x + y * y)
            rad = math.acos(math.fabs(x) / z)
            angle = rad * 180 / math.pi
            
            
            tcoeff = -1 + (angle / 90) * 2
            turn = tcoeff * math.fabs(math.fabs(y) - math.fabs(x))
            turn = round(turn * 100, 0) / 100
            
            mov = max(math.fabs(y), math.fabs(x))
        
            
            # First and third quadrant
            if (x >= 0 and y >= 0) or (x < 0 and y < 0):
                rawLeft = mov
                rawRight = turn
            else:
                rawRight = mov
                rawLeft = turn
            
            # Reverse polarity
            if y < 0:
                rawLeft = 0 - rawLeft
                rawRight = 0 - rawRight
            
            if rawRight > 0:
                right= -1 * map(rawRight, 0, maxSpeedSim, outputSpeedMin, outputSpeedMax)
            if rawRight < 0:
                right= -1 * map(rawRight, -maxSpeedSim, 0, -outputSpeedMax, -outputSpeedMin)
            
            if rawLeft > 0:
                left= map(rawLeft, 0, maxSpeedSim, outputSpeedMin, outputSpeedMax)
            if rawLeft < 0:
                left= map(rawLeft, -maxSpeedSim, 0, -outputSpeedMax, -outputSpeedMin)
            
            #if left < 0:
                #if right > 0:
                    #if right + left > 20:
                        #left = -1 * left 
                        #right = -1 * right 
                    
            rights.Add(right)
            lefts.Add(left)
    
        else:
            right=0
            left=0
            
            rights.Add(right)
            lefts.Add(left)
else:
    right=0
    left=0
# ---------- end ghpython_script_2 ----------
panel_11 = Panel(ghpython_script_2.lefts)
panel_12 = Panel(ghpython_script_2.rights)

negative = Negative(Value=panel_11)
negative_2 = Negative(Value=panel_12)
ma = MassAddition(Input=visualize.oNear)  # -> Result, PartialResults
ma_2 = MassAddition(Input=visualize.oCollected)  # -> Result, PartialResults
ma_3 = MassAddition(Input=visualize.oCollected)  # -> Result, PartialResults

item_2 = ListItem(List=visualize.oRobotVelocities, Index=0, Wrap=True)  # disabled
item_3 = ListItem(List=visualize.oRobotDirection, Index=0, Wrap=True)  # disabled
item_4 = ListItem(List=visualize.oNear, Index=0, Wrap=True)  # disabled
item_5 = ListItem(List=visualize.oRobotPositions, Index=0, Wrap=True)  # disabled
c_script_10 = CSharpScript(x=item_5)  # -> out, A; inputs x: Point3d; disabled
# ---------- c_script_10: C# ----------
    double a = x.X;
    double b = x.Y;
    double c = x.Z;
    a = Math.Round(a, 2);
    b = Math.Round(b, 2);
    c = Math.Round(c, 2);
    A = "( " + a.ToString() + ", " + b.ToString()  + " )";//+ ", " + c.ToString()
# ---------- end c_script_10 ----------
c_script_11 = CSharpScript(x=item_2)  # -> out, A; inputs x: Point3d; disabled; same code as c_script_10
c_script_12 = CSharpScript(x=item_3)  # -> out, A; inputs x: Point3d; disabled; same code as c_script_10
merge_4 = Merge(
    Data2=flatten(panel_8),
    Data3=flatten(c_script_10.A),
    Data4=flatten(panel_9),
    Data5=flatten(c_script_11.A),
    Data6=flatten(panel_6),
    Data7=flatten(c_script_12.A),
    Data8=flatten(panel_7),
    Data9=flatten(item_4))  # disabled
tag_2 = TextTag3D(Location=graft(arrrec_2.Geometry), Text=graft(merge_4), Size=number_slider_14, Colour=swatch_4, Justification=7)  # disabled

panel_13 = Panel(ma_2.Result)

lng_2 = ListLength(List=visualize.oMaterial)
subtraction = Subtraction(A=lng_2, B=ma.Result)
purifier_working = Panel(ma.Result)
purifier_working_2 = Panel(subtraction)
purifier_working_3 = Panel(ma_3.Result)
merge_5 = Merge(
    Data1=flatten("Waitting Robot:"),
    Data2=flatten(purifier_working_3),
    Data3=flatten("Total Robot:"),
    Data4=flatten(agent_count),
    Data5=flatten("Collected Material:"),
    Data6=flatten(panel_13),
    Data7=flatten("Grabed Material:"),
    Data8=flatten(purifier_working),
    Data9=flatten("Total Material:"),
    Data10=flatten(panel))
tag_3 = TextTag3D(
    Location=graft(arrrec.Geometry),
    Text=graft(merge_5),
    Size=Slider(46, range=0..100),
    Colour=ColourSwatch(SwatchColor=RGB(255, 255, 255)),
    Justification=7)
panel_14 = Panel(merge_5)

robot_points = Point(visualize.oRobotPositions)
visualize_2 = CSharpScript(
    iAgentSystem=solver.AllAgentSystems,
    agentId=number_slider_9,
    Reference="\\MAC\HOME\DESKTOP\2023DF\AHIMOV\SOFTWARE\DATAVERSE_FILES\ABXM.CORE-1.4.0\ABMFRAMEWORK.CORE\ABxM.Core.dll")  # -> out, Key, Value; inputs iAgentSystem: list, agentId: Int32
# ---------- visualize_2: C# usings ----------
using System.Linq;
using System.Drawing;
using System.Windows.Markup;
using ABxM.Core;
using ABxM.Core.Agent;
using ABxM.Core.AgentSystem;
using ABxM.Core.Behavior;
using ABxM.Core.Environments;
# ---------- visualize_2: C# ----------
    robotSystem = iAgentSystem[1] as BoidSystem;
    materialSystem = iAgentSystem[0] as CartesianAgentSystem;

    var agents = robotSystem.Agents;

    // Find the agent with the specified ID
    var agent = agents.Find(a => a.Id == agentId);

    if (agent != null)
    {
      var customData = agent.CustomData;

      // Convert the custom data to a list of objects
      var customDataValueList = customData.Values.ToList();
      var customDataKeyList = customData.Keys.ToList();

      Value = customDataValueList;
      Key = customDataKeyList;

    }
# ---------- visualize_2: C# additional code ----------
  private BoidSystem robotSystem;
  private CartesianAgentSystem materialSystem;
# ---------- end visualize_2 ----------
item_6 = ListItem(List=robot_points, Index=number_slider_9, Wrap=True)
lng_3 = ListLength(List=visualize_2.Key)
concat_2 = Concatenate(FragmentA=visualize_2.Key, FragmentC=" = ", FragmentB=visualize_2.Value)
vector_display = VectorDisplay(Anchor=visualize.oRobotPositions, Vector=visualize.oRobotVelocities)
series_2 = Series(Start=0, Step=1, Count=lng_3)
integer_4 = Integer(visualize.oNear)
multiplication_2 = Multiplication(A=neg_2, B=series_2)
move_2 = Move(Geometry=move.Geometry, Motion=multiplication_2)  # -> Geometry, Transform
concatenate_2 = Concatenate(FragmentA=negative_2, FragmentC=",", FragmentB=negative)
tag_4 = TextTag3D(
    Location=move_2.Geometry,
    Text=concat_2,
    Size=Slider(39, range=0..100),
    Colour=ColourSwatch(SwatchColor=RGB(255, 255, 255)),
    Justification=7)
list_item_3 = ListItem(List=integer_4, Index=series, Wrap=True)

# ----
# Robot Sight
robotsightrotation_3 = Number(sightrotationdegrees)
robotsight_2 = Number(pickupdistance)
robotsight_3 = Number(pickupdistance)
ovelocities = Vector(visualize.oRobotVelocities)
opositions = Point(graft(visualize.oRobotPositions))
amp_2 = Amplitude(Vector=visualize.oRobotDirection, Amplitude=expr("x/2", robotsight_3))  # -> graft(Vector)
amp_3 = Amplitude(Vector=ovelocities, Amplitude=expr("X/2", robotsight_3))  # -> graft(Vector)
amp_4 = Amplitude(Vector=visualize.oRobotDirection, Amplitude=robotsight_2)  # -> graft(Vector)
neg_3 = Negative(Value=robotsightrotation_3)
pl = ConstructPlane(Origin=visualize.oRobotPositions, XAxis=visualize.oRobotDirection, YAxis=Vector(0, 1, 0))  # -> graft(Plane)
move_3 = Move(Geometry=opositions, Motion=amp_3)  # -> Geometry, Transform
move_4 = Move(Geometry=opositions, Motion=amp_2)  # -> Geometry, Transform
move_5 = Move(Geometry=opositions, Motion=amp_4)  # -> Geometry, Transform
rotate_3 = Rotate(Geometry=move_5.Geometry, Angle=degrees(robotsightrotation_3), Plane=pl)  # -> Geometry, Transform
rotate_4 = Rotate(Geometry=move_5.Geometry, Angle=degrees(neg_3), Plane=pl)  # -> Geometry, Transform
circle_2 = CircleCNR(Center=opositions, Normal=Vector(0, 0, 1), Radius=expr("x/2", robotsight_3))
crv_cp = CurveClosestPoint(Point=[move_4.Geometry, move_3.Geometry], Curve=circle_2)  # -> Point, Parameter, Distance
merge_6 = Merge(Data1=opositions, Data2=rotate_3.Geometry, Data3=rotate_4.Geometry, Data4=opositions)
shatter = Shatter(Curve=circle_2, Parameters=crv_cp.Parameter)
len = Length(Curve=shatter)
pline = PolyLine(Vertices=merge_6, Closed=False)
sort_2 = SortList(Keys=len, ValuesA=shatter)  # -> Keys, ValuesA
not = GateNot(A=visualize.oNear)
item_7 = ListItem(List=sort_2.ValuesA, Index=0, Wrap=True)
mesh_4 = Mesh(pline)
cull = CullPattern(List=flatten(mesh_4), CullPattern=not)
cull_2 = CullPattern(List=flatten(mesh_4), CullPattern=visualize.oNear)
preview_4 = CustomPreview(Geometry=cull_2, Material=ColourSwatch(SwatchColor=RGBA(0, 35, 235, 130)))
preview_5 = CustomPreview(Geometry=cull, Material=ColourSwatch(SwatchColor=RGBA(240, 48, 48, 130)))
previewlw_2 = CustomPreviewLineweights(Geometry=item_7, Shader=ColourSwatch(SwatchColor=RGB(44, 71, 196)), Thickness=Slider(9, range=0..10), Absolute=False)

# ----
# Environment
Z = UnitZ(Factor=-10)
mesh_5 = Mesh(visualize.oMesh)
move_6 = Move(Geometry=mesh_5, Motion=Z)  # -> Geometry, Transform

number_slider_19 = Slider(40, range=0..100)
opositions_2 = Point(graft(pt_5))
amp_5 = Amplitude(Vector=visualize.oRobotDirection, Amplitude=Slider(300, range=0..1000))
X = UnitX(Factor=1)
neg_4 = Negative(Value=number_slider_19)
item_8 = ListItem(List=amp_5, Index=number_slider_9, Wrap=True)
pl_2 = ConstructPlane(Origin=pt_5, XAxis=X, YAxis=Vector(0, 1, 0))  # -> graft(Plane)
move_7 = Move(Geometry=pt_5, Motion=item_8)  # -> Geometry, Transform
rotate_5 = Rotate(Geometry=move_7.Geometry, Angle=degrees(number_slider_19), Plane=pl_2)  # -> Geometry, Transform
rotate_6 = Rotate(Geometry=move_7.Geometry, Angle=degrees(neg_4), Plane=pl_2)  # -> Geometry, Transform
merge_7 = Merge(Data1=opositions_2, Data2=rotate_5.Geometry, Data3=rotate_6.Geometry, Data4=opositions_2)
pline_2 = PolyLine(Vertices=merge_7, Closed=False)
mesh_6 = Mesh(pline_2)
preview_6 = CustomPreview(Geometry=mesh_6, Material=ColourSwatch(SwatchColor=RGBA(240, 48, 48, 130)))

opositions_3 = Point(visualize.oRobotPositions)
item_9 = ListItem(List=opositions_3, Index=number_slider_9, Wrap=True)
pt_8 = Point(<point referenced from the Rhino model>)
item_10 = ListItem(List=sort_2.ValuesA, Index=0, Wrap=True)
item_11 = ListItem(List=flatten(item_10), Index=number_slider_9, Wrap=True)
vec2pt = Vector2Pt(PointA=item_9, PointB=pt_8, Unitize=False)  # -> Vector, Length
move_8 = Move(Geometry=item_11, Motion=vec2pt.Vector)  # -> Geometry, Transform
scale = Scale(Geometry=move_8.Geometry, Center=pt_8, Factor=Slider(2, range=0..10))  # -> Geometry, Transform
previewlw_3 = CustomPreviewLineweights(
    Geometry=scale.Geometry,
    Shader=ColourSwatch(SwatchColor=RGB(44, 71, 196)),
    Thickness=Slider(10, range=0..50),
    Absolute=False)

# ----
# ROBOT COMMUNICATION
panel_15 = Panel("broker.hivemq.com")
panel_16 = Panel(robots_in_use)
setup = Button()
stop = BooleanToggle(True)
port = Integer("1883")
host = Text(panel_15)
publish = BooleanToggle(True)

# ----
# SEND MOTOR / GRIPPER
panel_17 = Panel("Gripper_Robot_")
concatenate_3 = Concatenate(FragmentA=panel_17, FragmentB=panel_16)

list_length_4 = ListLength(List=panel_16)
duplicate_data_2 = DuplicateData(Data="0", Number=list_length_4, Order=True)
duplicate_data_3 = DuplicateData(Data=concatenate, Number=list_length_4, Order=True)
concatenate_4 = Concatenate(FragmentA="Motors_Robot_", FragmentB=panel_16)
stream_filter = StreamFilter(Gate=stop, Stream0=list_item_3, Stream1=duplicate_data_2)
weave = Weave(Pattern=[0, 1], Stream0=concatenate_4, Stream1=concatenate_3, NullGaps=False)

# ----
# VISUALIZATION
# Robot
opositions_4 = Point(visualize.oRobotPositions)
ovelocities_2 = Vector(visualize.oRobotVelocities)
robot_radius_8 = Number(robot_radius)
amp_6 = Amplitude(Vector=ovelocities_2, Amplitude=expr("2*X", robot_radius_8))
circle_3 = CircleCNR(Center=opositions_4, Normal=Vector(0, 0, 1), Radius=robot_radius_8)
vdisex = VectorDisplayEx(Point=opositions_4, Vector=amp_6, Colour=ColourSwatch(SwatchColor=RGB(44, 71, 196)), Width=5)

number_slider_20 = Slider(2, range=0..10)
amp_7 = Amplitude(Vector=ovelocities_2, Amplitude=expr("2*X", Slider(150, range=0..1000)))
item_12 = ListItem(List=amp_7, Index=number_slider_9, Wrap=True)

mesh_7 = Mesh(circle_3)
series_3 = Series(Start=0, Step=1, Count=agent_count)

preview_7 = CustomPreview(Geometry=mesh_7, Material=ColourSwatch(SwatchColor=RGB(233, 240, 48)))
tag_5 = TextTag3D(
    Location=opositions_4,
    Text=series_3,
    Size=Slider(72, range=0..100),
    Colour=ColourSwatch(SwatchColor=RGB(0, 0, 0)),
    Justification=5)

vdisex_2 = VectorDisplayEx(Point=pt_5, Vector=item_12, Colour=ColourSwatch(SwatchColor=RGB(44, 71, 196)), Width=Slider(5, range=0..10))

opositions_5 = Point(visualize.oMaterial)
material_radius_8 = Number(material_radius)

addition_3 = Addition(A=material_radius_8, B=Slider(33, range=0..100))

circle_4 = CircleCNR(Center=opositions_5, Normal=Vector(0, 0, 1), Radius=addition_3)
mesh_8 = Mesh(circle_4)
preview_8 = CustomPreview(Geometry=mesh_8, Material=ColourSwatch(SwatchColor=RGB(230, 0, 255)))

# ----
# Material
number_slider_21 = Slider(39, range=0..100)
series_4 = Series(Start=0, Step=1, Count=material_count)
tag_6 = TextTag3D(Location=opositions_5, Text=series_4, Size=number_slider_21, Justification=5)

stream_filter_2 = StreamFilter(Gate=stop, Stream0=concatenate_2, Stream1=duplicate_data_3)

weave_2 = Weave(Pattern=[0, 1], Stream0=stream_filter_2, Stream1=stream_filter, NullGaps=False)

pub = GhPythonScript(setup=setup, publish=publish, host=host, port=port, msg=weave_2, topic=weave)  # -> out; inputs msg: list, topic: list
# ---------- pub: Python ----------
# Copyright (c) 2020 Ondrej Kyjanek <ondrej.kyjanek@gmail.com>
#
# All rights reserved. This program and the accompanying materials
# are made available under the terms of the Eclipse MIT license
# which accompanies this distribution.
#
# Contributors:
#    Ondrej Kyjanek - initial implementation

# Simple Grasshopper MQTT publisher

__author__ = "Ondrej Kyjanek"
__version__ = "2020.12.09"

from datetime import datetime
import paho.mqtt.client as mqttc
import paho.mqtt.properties as properties
from collections import deque

if setup and not setup_done:
    try:
        client.disconnect()
        client.loop_stop()
        client.reinitialise()
        print("Client reinitialized")
    except:
        print("Creating new client")
        client = mqttc.Client(protocol=mqttc.MQTTv5)
    client.connect(host,port,keepalive=10)
    client.loop_start()
    setup_done = True
    print("Starting")
elif setup:
    print("Already started")
else:
    setup_done = False

if publish:
    props = properties.Properties(properties.PacketTypes.PUBLISH)
    props.UserProperty = ("name","grasshopper")
    #print(props)
    
    for i in range(len(msg)):
        print(datetime.now().strftime("%H:%M:%S") + "  " + msg[i] + " will be sent on topic: " + topic[i])
        msg_info = client.publish(
            topic[i],
            payload=msg[i],
            qos=0,
            retain=False,
            properties=props
            )
# ---------- end pub ----------
panel_18 = Panel(pub)

# ==== cluster Cluster
M = ClusterInput()
demesh = DeconstructMesh(Mesh=M)  # -> Vertices, Faces, Colours, Normals
lng = ListLength(List=demesh.Colours)
c_script = CSharpScript(x=demesh.Colours, t=Slider(100, range=0..255))  # -> out, A; inputs x: list of Color, t: Int32
# ---------- c_script: C# ----------
    int a = 0;
    for(int i = 0;i < x.Count;i++)
    {
      if (x[i].A < t) a++;
    }

    A = a;
# ---------- end c_script ----------
division = Division(A=c_script.A, B=lng)
multiplication = Multiplication(A=division, B="100")
roundd = RoundToDecimalPlace(NumberX=multiplication, DecimalPlace="2", RoundType=0)  # -> Rounded, Difference
panel = ClusterOutput("%")
x = ClusterOutput(roundd.Rounded)
